# Grasshopper definition Simple.ghx (Grasshopper 1.0.7)
# plug-ins: Caribou

panel = Panel("addr:street=Taranaki Street")
panel_2 = Panel("building")
panel_3 = Panel("cuisine=mexican")
panel_4 = Panel("highway=traffic_signals")
specify_features = SpecifyFeatures(
    selectionIncludesObscure=True,
    selectionSerialised="aerialway=*,aeroway=*,amenity=*,barrier=*,boundary=*,building=*,craft=*,emergency=*,geological=*,healthcare=*,highway=*,historic=*,landuse=*,leisure=*,man_made=*,military=*,natural=*,office=*,place=*,power=*,public_transport=*,railway=*,route=*,shop=*,sport=*,telecom=*,tourism=*,water=*,waterway=*")  # -> OSMFeatures, Debug

# ---- group: Melbourne CBD
path = FilePath(["Z:\Sites\Caribou\Caribou.Tests\Cases\melbourne.xml", "/Users/philip/Sites/Caribou/Caribou.Tests/Cases/melbourne.xml"])

# ---- group: Wellington CBD
path_2 = FilePath(["/Users/philip/Sites/Caribou/Caribou.Tests/Cases/wellington-overpass-export.osm", "Z:\Sites\Caribou\Caribou.Tests\Cases\wellington-overpass-export.osm"])

# ----
text = Text(specify_features.OSMFeatures)
path_3 = FilePath(path_2)
extract_nodes = ExtractNodes(OSMFilePath=path_3, OSMFeatures=text)  # -> Nodes, Tags, Report, Debug
extract_ways = ExtractWays(OSMFilePath=path_3, OSMFeatures=text)  # -> Ways, Tags, Report, Debug
panel_5 = Panel(extract_ways.Report)

# ---- group: Visualise in Grasshopper with Per-Feature Colors
rectangle = Rectangle({Plane=PlaneXY(2853997.361, 4215706.086, 0), Size=Domain2(u=-365606.0237..365606.0237, v=-1119584.746..1119584.746)})
point = Point(extract_nodes.Nodes)
text_2 = Text(extract_nodes.Report)
geometry = Geometry(extract_ways.Ways)
color_per_branch = ColorPerBranch(geometry=[point, geometry])  # -> geometry_4, colour_2
list_item = ListItem(List=text_2, Index="0", Wrap=True)  # -> flatten(Item)
legend = Legend(Colour=color_per_branch.colour_2, Tags=list_item, Rectangle=rectangle, LegendType=1)
custom_preview = CustomPreview(Geometry=geometry, Material=simplify(graft(color_per_branch.colour_2)))
custom_preview_2 = CustomPreview(Geometry=point, Material=simplify(graft(color_per_branch.colour_2)))

# ==== cluster ColorPerBranch
geometry = ClusterInput()
geometry_2 = Geometry(geometry)
group = Group(Objects=geometry_2)  # -> flatten(Group)
list_length = ListLength(List=group)
panel = Panel(group)
series = Series(Start=0, Step=1, Count=list_length)
gradient = Gradient(
    LowerLimit=0,
    UpperLimit=list_length,
    Parameter=series,
    stops=[0: RGB(243, 57, 0), 0.1: RGB(236, 27, 60), 0.2: RGB(210, 0, 118), 0.3: RGB(103, 0, 120), 0.4: RGB(39, 72, 161), 0.5: RGB(1, 192, 229), 0.6: RGB(18, 178, 90), 0.7: RGB(79, 186, 8), 0.8: RGB(220, 237, 32), 0.9: RGB(247, 159, 20), 1: RGB(243, 57, 0)])
geometry_3 = Geometry(geometry_2)
colour = Colour(gradient)
geometry_4 = ClusterOutput(geometry_3)
colour_2 = ClusterOutput(colour)
